# Grasshopper definition 03_Pickle_to_AI.gh (Grasshopper 0.9.69)
# plug-ins: LocalCode, Python Interpreter

panel = Panel("""Linework_Buildings
Linework_Cityfeatures
Linework_CityLots
Linework_Drainage_Lines_NonSite
Linework_Drainage_Lines_Site
Linework_Impervious
Linework_InterventionOutlines
Linework_Shadows01_Equinox
Linework_Shadows02_Summer
Linework_Shadows03_Winter
Linework_SurfaceOutlines""")
panel_2 = Panel("G:\Local Code\Work\Local Code - San Francisco\06 DB\Pickles\")
number_slider = Slider(22, range=1..250)
toggle = BooleanToggle(True)
unpickle_view = UnpickleView(siteNumber=number_slider, path=panel_2, UnPickle=toggle)  # -> out, geometry, vector, target
# ---------- unpickle_view: Python ----------
import os
import time

import Rhino
import cPickle as pickle
import rhinoscriptsyntax as rs
from scriptcontext import doc

if UnPickle:
    f = open(path + '%sview' % int(siteNumber), 'rb')
    view = pickle.load(f)
    f.close()
    if len(view) == 3:
        geometry = view[0]
        vector = Rhino.Geometry.Vector3d(view[1])
        target = view[2]
    else:
        print 'bad view data'
    
    vp = doc.Views.ActiveView.ActiveViewport
    vp.SetCameraDirection( vector, True)
    vp.SetCameraTarget(target, True)
    bb = geometry.GetBoundingBox(True)
    vp.ZoomBoundingBox( bb)
    doc.Views.ActiveView.Redraw()
    #return view
# ---------- end unpickle_view ----------
unpickle_geometry = UnPickleGeometry(siteNumber=number_slider, layer=panel, path=panel_2, read=toggle)  # -> out, simplify(geometry)
# ---------- unpickle_geometry: Python ----------
import cPickle as pickle

if path and read and layer:
    try:
        if siteNumber:
            f = open(path+str(int(siteNumber))+layer)
        else:
            f = open(path+layer)
        geometry = pickle.load(f)
        f.close()

    except:
        print 'problem loading %s\nfile may not exist' % path+str(int(siteNumber))+layer
# ---------- end unpickle_geometry ----------
unpickle_geometry_2 = UnPickleGeometry(siteNumber=number_slider, layer="Data_CNN", path=panel_2, read=toggle)  # -> out, geometry; same code as unpickle_geometry
panel_3 = Panel("G:\Local Code\Work\Local Code - San Francisco\06 DB\Step2-AI\")
merge = Merge(
    Data1=ColourSwatch(SwatchColor=RGB(153, 0, 255)),
    Data2=ColourSwatch(SwatchColor=RGB(91, 143, 83)),
    Data3=ColourSwatch(SwatchColor=RGB(0, 255, 170)),
    Data4=ColourSwatch(SwatchColor=RGB(140, 122, 255)),
    Data5=ColourSwatch(SwatchColor=RGB(34, 0, 255)),
    Data6=ColourSwatch(SwatchColor=RGB(0, 255, 102)),
    Data7=ColourSwatch(SwatchColor=RGB(255, 0, 221)),
    Data8=ColourSwatch(SwatchColor=RGB(64, 64, 64)),
    Data9=ColourSwatch(SwatchColor=RGB(112, 112, 112)),
    Data10=ColourSwatch(SwatchColor=RGB(176, 176, 176)),
    Data11=ColourSwatch(SwatchColor=RGB(196, 100, 164)))
concat = Concatenate(FragmentA=panel_3, FragmentB=unpickle_geometry_2.geometry)
concat_2 = Concatenate(FragmentA=concat, FragmentB=".ai")
localcodeexport = LocalCodeExport(
    DestinationFilePath=concat_2,
    Export=Toggle(True),
    LayerNames=panel,
    LayerColors=merge,
    GeometryTree=unpickle_geometry.geometry)
